# Grasshopper definition CustomEA.gh (Grasshopper 0.9.76)
# plug-ins: FabUnionRobot

number_slider = Slider(100, range=0..100)
Y = UnitY(Factor=1)
mesh = Mesh(<mesh referenced from the Rhino model>)
mesh_2 = Mesh(<mesh referenced from the Rhino model>)
material = CreateMaterial(
    Diffuse=ColourSwatch(SwatchColor=RGB(255, 255, 255)),
    Specular=RGB(255, 255, 255),
    Emission=RGB(0, 0, 0),
    Transparency=0,
    Shine=0)
material_2 = CreateMaterial(
    Diffuse=ColourSwatch(SwatchColor=RGB(255, 255, 255)),
    Specular=RGB(255, 255, 255),
    Emission=RGB(0, 0, 0),
    Transparency=0,
    Shine=0)
crv = Curve(<curve referenced from the Rhino model>)
ceap = ComposeCustomExternalAxisPart(
    Mesh=mesh_2,
    Vector=Vector(1, 0, 0),
    ValueID=Slider(0, range=0..100),
    ValueLimit=Domain(-10000, 10000),
    IsCoupling=True,
    Mat=material)
ceap_2 = ComposeCustomExternalAxisPart(Mesh=mesh, Vector=Y, ValueID=Slider(1, range=0..1), ValueLimit=Domain(-10000, 10000), IsCoupling=True, Mat=material_2)
dbsl = DivideBySegWithLength(Curve=crv, Length=8, Len=8)
pt = Point(<point referenced from the Rhino model>)
xy = XYPlane(Origin=pt)
eac = ExternalAxisCompose(Point=dbsl, E1=Slider(328, range=0..1000), E2=0, E3=0, E4=0)
R = KR10R9002()
mc = MoveCmd(Plane=dbsl, EAxis=eac, Zone=10, IsLineMode=False, robotState=-1)
acmd = ComposeAngleCmd(
    A1=Slider(13, range=-90..90),
    A2=Slider(-45, range=-90..90),
    A3=Slider(39, range=-90..90),
    A4=0,
    A5=Slider(-36, range=-90..90),
    A6=0)
cctea = ComposeCustomTranslateExternalAxis(Robot=R, OriginalPlane=xy, EAPart0=ceap, EAPart1=ceap_2)
T = LightPlasticToolhead(Index=1)
merge = Merge(Data1=acmd, Data2=mc)
rc = RobotCore(Simulation=Slider(1, range=0..1), Command=merge, Tool=T, Robot=cctea, btnFile=True, btnMode=False)  # -> AllCMDs, Angle, AllAngles, TCP, AllTCPs, Geo, RootPlane, CheckInfo
