# Grasshopper definition CustomizeRobot.gh (Grasshopper 0.9.76)
# plug-ins: FUROBOT

col = Colour(ColourSwatch(SwatchColor=RGB(255, 98, 0)))
mesh = Mesh(<mesh referenced from the Rhino model>)
crv = Curve(<curve referenced from the Rhino model>)
cgp = ComposeGeneralPart(Mesh=mesh, Mat=col)
dom = ConstructDomain(DomainStart=Slider(-90, range=-170..0), DomainEnd=Slider(70, range=0..1000))
dbsl = DivideBySegWithLength(Curve=crv, Length=8, Len=8)
dom_2 = ConstructDomain(DomainStart=Slider(-110, range=-360..0), DomainEnd=Slider(110, range=0..1000))
eac = ExternalAxisCompose(Point=dbsl, E1=Slider(289, range=0..1000), E2=0, E3=0, E4=0)
swatch = ColourSwatch(SwatchColor=RGB(66, 66, 66))
mesh_2 = Mesh(<mesh referenced from the Rhino model>)

# ---- group: ABB LOGO
mesh_3 = Mesh(<mesh referenced from the Rhino model>)
cgp_2 = ComposeGeneralPart(Mesh=mesh_3, Mat=ColourSwatch(SwatchColor=RGB(0, 0, 0)))

# ----
mesh_4 = Mesh(<mesh referenced from the Rhino model>)
mesh_5 = Mesh(<mesh referenced from the Rhino model>)
mesh_6 = Mesh(<mesh referenced from the Rhino model>)
mesh_7 = Mesh(<mesh referenced from the Rhino model>)
mesh_8 = Mesh(<mesh referenced from the Rhino model>)
dom_3 = ConstructDomain(DomainStart=Slider(-165, range=-170..0), DomainEnd=Slider(165, range=0..1000))
cgp_3 = ComposeGeneralPart(Mesh=mesh_5, Mat=col)
cgp_4 = ComposeGeneralPart(Mesh=mesh_4, Mat=col)
cgp_5 = ComposeGeneralPart(Mesh=mesh_2, Mat=col)
cgp_6 = ComposeGeneralPart(Mesh=mesh_6, Mat=col)
dom_4 = ConstructDomain(DomainStart=Slider(-160, range=-360..0), DomainEnd=Slider(160, range=0..1000))
cgp_7 = ComposeGeneralPart(Mesh=mesh_7, Mat=ColourSwatch(SwatchColor=RGB(0, 0, 0)))
swatch_2 = ColourSwatch(SwatchColor=RGB(255, 170, 0))
dom_5 = ConstructDomain(DomainStart=Slider(-120, range=-360..0), DomainEnd=Slider(120, range=0..1000))
mesh_9 = Mesh(<mesh referenced from the Rhino model>)
cgp_8 = ComposeGeneralPart(Mesh=mesh_8, Mat=col)
mc = MoveCmd(Plane=dbsl, EAxis=eac, Zone=10, IsLineMode=False, robotState=6)
nickname = CustomRobotPart(ValueLimit=dom_4, Parts=[cgp_5, cgp_2])
nickname_2 = CustomRobotPart(ValueLimit=dom_3, Parts=cgp_8)
nickname_3 = CustomRobotPart(ValueLimit=dom_2, Parts=cgp)
nickname_4 = CustomRobotPart(ValueLimit=dom, Parts=cgp_6)
nickname_5 = CustomRobotPart(ValueLimit=dom_5, Parts=[cgp_4, cgp_3])
cgp_9 = ComposeGeneralPart(Mesh=mesh_9, Mat=col)
nickname_6 = CustomRobotPart(ValueLimit=Domain(-180, 180), Parts=cgp_9)
dom_6 = ConstructDomain(DomainStart=Slider(-400, range=-400..0), DomainEnd=Slider(400, range=0..1000))
nickname_7 = CustomRobotPart(ValueLimit=dom_6, Parts=cgp_7)
customabb = CustomABB(
    R0=nickname_6,
    R1=nickname_2,
    R2=nickname_3,
    R3=nickname_4,
    R4=nickname,
    R5=nickname_5,
    R6=nickname_7,
    A="290",
    B="0",
    C="270",
    D="70",
    E="302",
    F="72")
acmd = ComposeAngleCmd(
    A1=Slider(1, range=-180..180),
    A2=Slider(14, range=-180..180),
    A3=Slider(9, range=-180..180),
    A4=0,
    A5=Slider(-40, range=-180..180),
    A6=0)
T = LightPlasticToolhead(Index=1)
merge = Merge(Data1=acmd, Data2=mc)
rc = RobotCore(Simulation=Slider(1, range=0..1), Command=merge, Tool=T, Robot=customabb, btnFile=False, btnMode=False)  # -> AllCMDs, Angle, AllAngles, TCP, AllTCPs, Geo, RootPlane, CheckInfo
panel = Panel(rc.Angle)
